# Grasshopper definition CarboCrocSampleProject.gh (Grasshopper 1.0.8)
# plug-ins: CarboCroc

# ---- group: GEOMETRY
# GEOMETRY CREATION
number_slider = Slider(9, range=0..50)
number_slider_2 = Slider(0.169, range=0.1..1)
number_slider_3 = Slider(0.292, range=0.1..1)
number_slider_4 = Slider(3, range=0..5)
pt = ConstructPoint(XCoordinate=number_slider, YCoordinate=0, ZCoordinate=0)
pt_2 = ConstructPoint(XCoordinate=number_slider, YCoordinate=number_slider, ZCoordinate=0)
pt_3 = ConstructPoint(XCoordinate=0, YCoordinate=number_slider, ZCoordinate=0)
pt_4 = ConstructPoint(XCoordinate=0, YCoordinate=0, ZCoordinate=0)
num = Number(number_slider)
multiplication = Multiplication(A=number_slider_2, B="-1")
vec = VectorXYZ(XComponent=number_slider_2, YComponent=number_slider_2, ZComponent=0)  # -> Vector, Length
vec_2 = VectorXYZ(XComponent=multiplication, YComponent=multiplication, ZComponent=0)  # -> Vector, Length
pt_5 = ConstructPoint(XCoordinate=0, YCoordinate=0, ZCoordinate=0)
pline = PolyLine(Vertices=[pt_4, pt, pt_2, pt_3], Closed=True)
vec_3 = VectorXYZ(XComponent=0, YComponent=0, ZComponent=number_slider_3)  # -> Vector, Length
vec_4 = VectorXYZ(XComponent=0, YComponent=0, ZComponent=number_slider_4)  # -> Vector, Length
move = Move(Geometry=pt_5, Motion=vec.Vector)  # -> Geometry, Transform
srf = Surface(pline)
move_2 = Move(Geometry=pt_5, Motion=vec_2.Vector)  # -> Geometry, Transform
rec_2pt = Rectangle2Pt(Plane=PlaneXY(0, 0, 0), PointA=move.Geometry, PointB=move_2.Geometry, Radius=0)  # -> Rectangle, Length
extr = Extrude(Base=srf, Direction=vec_3.Vector)
srf_2 = Surface(rec_2pt.Rectangle)
multiplication_2 = Multiplication(A=number_slider_3, B="1000")
num_2 = Number(num)
extr_2 = Extrude(Base=srf_2, Direction=vec_4.Vector)
move_3 = Move(Geometry=extr, Motion=vec_4.Vector)  # -> Geometry, Transform
vec_5 = VectorXYZ(XComponent=0, YComponent=0, ZComponent=number_slider_4)  # -> Vector, Length
join = TextJoin(Text=[multiplication_2, " THK RC SLAB"])
vec_6 = VectorXYZ(XComponent=num_2, YComponent=0, ZComponent=0)  # -> Vector, Length
vec_7 = VectorXYZ(XComponent=num_2, YComponent=num_2, ZComponent=0)  # -> Vector, Length
vec_8 = VectorXYZ(XComponent=0, YComponent=num_2, ZComponent=0)  # -> Vector, Length
move_4 = Move(Geometry=extr_2, Motion=[vec_6.Vector, vec_7.Vector, vec_8.Vector])  # -> Geometry, Transform
panel = Panel(join)
geo = Geometry(move_3.Geometry)
geo_2 = Geometry([move_4.Geometry, extr_2])
move_5 = Move(Geometry=geo, Motion=vec_5.Vector)  # -> Geometry, Transform
move_6 = Move(Geometry=geo_2, Motion=vec_5.Vector)  # -> Geometry, Transform
volume = Volume(Geometry=[geo, move_5.Geometry])  # -> Volume, Centroid
volume_2 = Volume(Geometry=[geo_2, move_6.Geometry])  # -> Volume, Centroid
panel_2 = Panel("Steel")

# ----
# CARBOCROC
# TEMPLATE SELECT
carbotemplateselector = CarboTemplateSelector(SelectedIndex=0)  # -> TemplatePath, TemplateName
panel_3 = Panel(carbotemplateselector.TemplatePath)
panel_4 = Panel(carbotemplateselector.TemplateName)
set_a_carbolifecalc_template = SetACarboLifeCalcTemplate(Path=panel_3, Set=Button())  # -> Message, TemplatePath
panel_5 = Panel(set_a_carbolifecalc_template.Message)
panel_6 = Panel(set_a_carbolifecalc_template.TemplatePath)

# ----
# VISUALISATION
number_slider_5 = Slider(157, range=0..1000)
number_slider_6 = Slider(217, range=0..1000)
rgb = ColourRGB(Alpha=255, Red=number_slider_5, Green=number_slider_5, Blue=number_slider_5)
rgb_2 = ColourRGB(Alpha=255, Red=number_slider_6, Green=number_slider_6, Blue=number_slider_6)
material = CreateMaterial(Diffuse=rgb, Specular=RGB(255, 255, 255), Emission=RGB(0, 0, 0), Transparency=0, Shine=0)
material_2 = CreateMaterial(Diffuse=rgb_2, Specular=RGB(255, 255, 255), Emission=RGB(0, 0, 0), Transparency=0, Shine=0)
preview = CustomPreview(Geometry=[move_6.Geometry, geo_2], Material=material)
preview_2 = CustomPreview(Geometry=[move_5.Geometry, geo], Material=material_2)

# ---- group: Settings
boolean_toggle = BooleanToggle(True)  # "A1-A3"
a4 = BooleanToggle(True)
a5 = BooleanToggle(True)
boolean_toggle_2 = BooleanToggle(True)  # "B1-B6"
boolean_toggle_3 = BooleanToggle(True)  # "C1-C4"
D = BooleanToggle(False)
sequestration = BooleanToggle(True)
additional = BooleanToggle(True)
carbo_life_switches = CarboLifeSwitches(
    A1A3=boolean_toggle,
    A4=a4,
    A5=a5,
    B1B6=boolean_toggle_2,
    C1C4=boolean_toggle_3,
    D=D,
    Seq=sequestration,
    Extra=additional)  # -> Message, CarboSwitches
panel_7 = Panel(carbo_life_switches.Message)

# ---- group: CarboCalc
# CARBOCROC
# CALCULATION
carbomaterialselect = CarboMaterialSelect(
    TemplatePath=panel_3,
    LastPath="C:\Users\d.veld\source\repos\CarboLifeCalc - NET2\CarboLifeCalc\bin\x64\Debug\net8.0-windows\db\UserMaterials.cxml",
    SelectedIndex=0)
list_all_materials = ListMaterials(MaterialTemplate=panel_3)
carbomaterialselect_2 = CarboMaterialSelect(
    TemplatePath=panel_3,
    LastPath="C:\Users\d.veld\source\repos\CarboLifeCalc - NET2\CarboLifeCalc\bin\x64\Debug\net8.0-windows\db\UserMaterials.cxml",
    SelectedIndex=0)
geo_3 = Geometry([geo, move_5.Geometry])
geo_4 = Geometry([move_6.Geometry, geo_2])
panel_9 = Panel(carbomaterialselect_2)
panel_10 = Panel(panel)
panel_11 = Panel(list_all_materials)
panel_12 = Panel(carbomaterialselect)
c_script = CSharpScript(geo=geo_4)  # -> out, guid
# ---------- c_script: C# ----------
// Grasshopper Script Instance
#region Usings
using System;
using System.Linq;
using System.Collections;
using System.Collections.Generic;
using System.Drawing;

using Rhino;
using Rhino.Geometry;

using Grasshopper;
using Grasshopper.Kernel;
using Grasshopper.Kernel.Data;
using Grasshopper.Kernel.Types;
#endregion

public class Script_Instance : GH_ScriptInstance
{
    #region Notes
    /* 
      Members:
        RhinoDoc RhinoDocument
        GH_Document GrasshopperDocument
        IGH_Component Component
        int Iteration

      Methods (Virtual & overridable):
        Print(string text)
        Print(string format, params object[] args)
        Reflect(object obj)
        Reflect(object obj, string method_name)
    */
    #endregion

    private void RunScript(object geo, ref object guid)
    {
        Guid newGuid = Guid.NewGuid();

        // Write your logic here
        guid = newGuid;
    }
}
# ---------- end c_script ----------
c_script_2 = CSharpScript(geo=geo)  # -> out, guid; same code as c_script
id = Guid(c_script.guid)
carbo_life_element = CarboLifeElement(IdGUID="1111", ElementName="RC Slab", MaterialName=panel_9, Volume=volume_2.Volume, Category="Floor", GUID=id)  # -> CarboElement, Message
carbo_life_element_2 = CarboLifeElement(IdGUID="1111", ElementName=panel_10, MaterialName=panel_12, Volume=volume.Volume, Category="Floor", GUID=c_script_2.guid)  # -> CarboElement, Message
carbo_life_geo_element = CarboLifeGeoElement(IdGUID="1111", ElementName=panel, MaterialName=panel_12, Geometry=geo_3, Category="Floor")  # -> CarboElement, Message
panel_13 = Panel(carbo_life_element.CarboElement)
panel_14 = Panel(carbo_life_element.Message)
number_slider_7 = Slider(0.1, range=0..1)
panel_15 = Panel(carbo_life_element_2.CarboElement)
panel_16 = Panel(carbo_life_element_2.Message)
carbo_life_project_solver_by_elements = ProjectElementSolver(
    CarboElements=[carbo_life_element_2.CarboElement, carbo_life_geo_element.CarboElement],
    Switches=carbo_life_switches.CarboSwitches,
    TemplatePath=panel_3,
    Uncertainty=number_slider_7)  # -> Total, CarboProject, Message, Txt

# ----
create_a_carbogroup = CarboGroup(CarboElements=carbo_life_element_2.CarboElement, MaterialTemplate=panel_3)  # -> CarboGroup, Message

# ---- group: Create Project By Groups
material_3 = Materials({"Concrete - Mortar/screed": 0, "Concrete UK - C40/50 - Precast": 1, "Concrete UK - C32/40 - 25% GGBS": 2, "Concrete UK - C25/30 - 25% GGBS": 3, "Concrete UK - C20/25 - 25% GGBS": 4, "Concrete UK - C16/20 - 25% GGBS": 5, "Concrete UK - C40/50 - 25% GGBS": 6, "Concrete - C32/40 Mean": 7, "Concrete UK - C40/50 - Precast 150mm Hollowcore": 8, "Steel UK - Reinforcement": 9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}, selected="Steel - Generic": 82)
material_4 = Materials({"Concrete - Mortar/screed": 0, "Concrete UK - C40/50 - Precast": 1, "Concrete UK - C32/40 - 25% GGBS": 2, "Concrete UK - C25/30 - 25% GGBS": 3, "Concrete UK - C20/25 - 25% GGBS": 4, "Concrete UK - C16/20 - 25% GGBS": 5, "Concrete UK - C40/50 - 25% GGBS": 6, "Concrete - C32/40 Mean": 7, "Concrete UK - C40/50 - Precast 150mm Hollowcore": 8, "Steel UK - Reinforcement": 9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}, selected="Concrete UK - C32/40 - 25% GGBS")
list_all_materials_2 = ListMaterials()
list_all_materials_3 = ListMaterials()
item = ListItem(List=list_all_materials_2, Index=material_3, Wrap=True)
item_2 = ListItem(List=list_all_materials_3, Index=material_4, Wrap=True)
select_a_carbomaterial = SelectMaterials(MaterialName=item_2, MaterialCategory="Concrete")  # -> CM, String
select_a_carbomaterial_2 = SelectMaterials(MaterialName=item, MaterialCategory="Steel")  # -> CM, String
carbo_life_group_project_solver = ProjectGroupSolver(
    CarboGroups=create_a_carbogroup.CarboGroup,
    Switches=carbo_life_switches.CarboSwitches,
    TemplatePath=panel_3,
    Uncertainty=number_slider_7)  # -> Total, CarboProject, Message, Txt
panel_17 = Panel(carbo_life_group_project_solver.Total)

# ----
panel_18 = Panel(select_a_carbomaterial.String)
panel_19 = Panel(select_a_carbomaterial_2.String)

panel_20 = Panel(carbo_life_project_solver_by_elements.Txt)
panel_21 = Panel(carbo_life_project_solver_by_elements.CarboProject)
panel_22 = Panel(carbo_life_project_solver_by_elements.Message)
panel_23 = Panel(carbo_life_project_solver_by_elements.Total)
split = TextSplit(Text=panel_22, Separators=";")  # -> simplify(Result)
panel_24 = Panel(split)
int = Integer(1)
item_3 = ListItem(List=panel_24, Index=int, Wrap=True)
flatten = FlattenTree(Tree=item_3, Path="{0}")
panel_25 = Panel(flatten)
normalise = CSharpScript(x=panel_25)  # -> out, A; inputs x: list of Double
# ---------- normalise: C# ----------
    List<double> result = new List<double>();

    foreach(double nr in x)
    {
      if(nr < 0)
      {
        result.Add(Math.Round(nr * -1,1));
      }

      if(nr > 0)
      {
        result.Add(Math.Round(nr,1));
      }

    }
    A = result;
# ---------- end normalise ----------
panel_26 = Panel(normalise.A)
repeat = RepeatData(Data=graft(normalise.A), Length=graft(normalise.A))  # -> flatten(Data)
pie = PieChart(repeat)

# ---- group: Save Project
save_project = SaveACarboLifeProject(Project=carbo_life_group_project_solver.CarboProject, Path="C:\Temp\RhinoSave.clcx", Save=Toggle(True))
panel_27 = Panel(save_project)

# ----
split_2 = TextSplit(Text=carbo_life_group_project_solver.Message, Separators=";")  # -> simplify(Result)
panel_28 = Panel(split_2)
int_2 = Integer(1)
item_4 = ListItem(List=panel_28, Index=int_2, Wrap=True)
flatten_2 = FlattenTree(Tree=item_4, Path="{0}")
panel_29 = Panel(flatten_2)
normalise_2 = CSharpScript(x=panel_29)  # -> out, A; inputs x: list of Double; same code as normalise
panel_30 = Panel(normalise_2.A)
repeat_2 = RepeatData(Data=graft(normalise_2.A), Length=graft(normalise_2.A))  # -> flatten(Data)
pie_2 = PieChart(repeat_2)
